vi "main.gviweb"   [LabVIEW NXG 4.0.0]
panel controls:
  "error in": error
  "Power Button": bool
panel indicators:
  "Card_1": T1
  "Card_2": T1
  "Card_3": T1
  "Card_4": T1
  "Card_5": T1
  "Card_6": T1
  "Card_7": T1
  "Card_8": T1
  "dockBar": string
  "URL Image": string
  "freeNum": string
  "URL Image_2": string
  "busyNum": string
  "URL Image_3": string
  "awayNum": string
  "URL Image_4": string
  "Talks": string
  "errror out": error
  "Time": string
  "Date": string
types:
  T1 = cluster{"AE-Photo": string, "Radial Progress Bar": f64, "CurrentStatePeriod": string, "FullName": string, "ColorCircle": string, "CardBackground": string}
uses:
  SubVIs::DateAndTime.gvi
  NI::Skyline::Configuration::Open Configuration (Desktop).gvi
  SubVIs::createBasicTag.gvi
  SubVIs::readBasicTag.gvi
  SubVIs::createCardTag.gvi
  SubVIs::readCardTag.gvi
  NI::Skyline::TagHTTP::Close Tag (Multiple).gvi
  NI::Skyline::Configuration::Close Configuration.gvi
diagram:
  w1 = $"error in"
  Build Array(reference to "Card_1", reference to "Card_2", reference to "Card_3", reference to "Card_4", reference to "Card_5", reference to "Card_6", reference to "Card_7", reference to "Card_8") -> w2
  while (after w2) {
    call "DateAndTime.gvi"(Error In=w1) -> (Date=w3, Time=w4, Error Out=w5)
    $Date <- w3
    $Time <- w4
    Wait(time to wait=1000)
    stop if $"Power Button"
  }
  call "Open Configuration (Desktop).gvi"(server url="http://sh-ae-board", username="admin", password="Dashboard", error in=w1) -> (configuration=w6, error out=w7)
  while {
    call "createBasicTag.gvi"(configuration=w6, error in=w7) -> (tags=w8, error out=w9)
    call "readBasicTag.gvi"(tags in=w8, error in=w9) -> (Output=w10, errror out=w11)
    Array To Cluster[NumberOfClusterElements=6](array=w10) -> (cluster=w12)
    Property Node(instance in=w12) -> ("Element 1"=w13, "Element 2"=w14, "Element 3"=w15, "Element 4"=w16)
    $awayNum <- w15
    for (N = 8) (iteration -> i1) {
      w17 = each element of w2
      Increment(x=i1) -> w18
      call "createCardTag.gvi"(configuration=w6, error in=w11, Card No=w18) -> (tags=w19, error out=w20)
      call "readCardTag.gvi"(tags in=w19, error in=w20) -> (tags out=w21, state cluster=w22, errror out=w23)
      Property Node(instance in=w22) -> ("Element 1"=w24, "Element 2"=w25, "Element 3"=w26, "Element 4"=w27, "Element 5"=w28, "Element 6"=w29)
      Build Cluster(w29, w26, w28, w25, w27, "Resources/CardBG.png") -> w30
      Property Node(instance in=w17, "Value"=w30, "Visible"=w24)
      call "Close Tag (Multiple).gvi"(tags=w21, error in=w23) -> (error out=w31)
    }
    $Talks <- w16
    $freeNum <- w13
    $busyNum <- w14
    stop if $"Power Button"
  }
  call "Close Configuration.gvi"(configuration=w6, error in=w31) -> (error out=w32)
  Merge Errors(w32, w5) -> (error out=w33)
  $"errror out" <- w33
