vi "createCardTag.gvi"   [LabVIEW NXG 4.0.0]
inputs:
  "error in": error
  "Card No": i32 = 8
  "configuration": "Configuration.gtype"
outputs:
  "error out": error
  "tags": "Tag.gtype"[]
types:
  "DataType.gtype" = enum{"Double", "I32", "String", "Boolean", "U64", "Timestamp"}
  "Client Handle.gtype" = u32
  "Configuration.gtype" = cluster{"Server URL": string, "Session": "Client Handle.gtype"}
  "Tag.gtype" = cluster{"Path": string, "Datatype": "DataType.gtype", "Configuration": "Configuration.gtype"}
uses:
  NI::Skyline::TagHTTP::Open Tag.gvi
diagram:
  w1 = ["SystemLink.Dashboard.Card.Visible.Card", "SystemLink.Dashboard.Card.FullName.Card", "SystemLink.Dashboard.Card.ProgressBar.Card", "SystemLink.Dashboard.Card.StateColor.Card", "SystemLink.Dashboard.Card.TimeInState.Card", "SystemLink.Dashboard.Card.PhotoPath.Card", "", "", "", "", "", "", "", "", "", "", "", "", "", ""]
  s1 = string[] []  # shift register
  for (N = 6) {
    w2 = each element of w1
    Number To Decimal String(number=$"Card No") -> (decimal integer string=w3)
    Concatenate Strings(w2, w3) -> w4
    Insert Into Array(inArray=s1, new=w4) -> w5
    next s1 = w5
  }
  Build Array("Boolean", "String", "Double", "String", "String", "String") -> w6
  for {
    w7 = each element of s1
    w8 = each element of w6
    call "Open Tag.gvi"(path=w7, data type=w8, error in=$"error in", configuration=$configuration) -> (tag=w10, error out=w11)
    append w10 to w9
    stop if w11
  }
  $tags <- w9
  $"error out" <- w11
