vi "main.gvi"   [LabVIEW NXG 4.0.0]
panel controls:
  "error in": error
  "stop": bool
panel indicators:
  "error out": error
  "loop iteration_2": i32
types:
  T1 = cluster{"Element 0": string, "Element 1": string, "Element 2": string, "Element 3": string, "Element 4": string, "Element 5": string, "Element 6": string}
uses:
  NI::Skyline::Configuration::Open Configuration (Desktop).gvi
  desktop::python.gvi
  desktop::text.gvi
  SubVIs::createBasicTag.gvi
  SubVIs::writeBasicTag.gvi
  NI::Skyline::TagHTTP::Close Tag (Multiple).gvi
  SubVIs::sendState.gvi
  NI::Skyline::TagHTTP::Open Tag.gvi
  NI::Skyline::TagHTTP::Write Tag (Boolean).gvi
  NI::Skyline::TagHTTP::Close Tag (Single).gvi
  NI::Skyline::Configuration::Close Configuration.gvi
diagram:
  w1 = $"error in"
  call "Open Configuration (Desktop).gvi"(server url="http://sh-ae-board", username="admin", password="Dashboard", error in=w1) -> (configuration=w2, error out=w3)
  while {
    call "python.gvi"(error in=w3) -> (error out=w4)
    call "text.gvi"(error in=w4) -> (basicState Array=w5, aeState Array=w6, error out=w7)
    Array To Cluster[NumberOfClusterElements=6](array=w5) -> (cluster=w8)
    sequence {
      frame 0 {
        Property Node(instance in=w8) -> ("Element 1"=w9, "Element 2"=w10, "Element 3"=w11, "Element 5"=w12)
        Decimal String To Number(string=w11) -> (number=w13)
        Decimal String To Number(string=w9) -> (number=w14)
        Decimal String To Number(string=w10) -> (number=w15)
        Add(w14, w15) -> w16
        Add(w16, w13) -> w17
      }
    }
    Subtract(x=8, y=w17) -> w18
    Array Size(array=w6) -> (size(s)=w19)
    Array To Cluster[NumberOfClusterElements=9](array=w19) -> (cluster=w20)
    Property Node(instance in=w20) -> ("Element 0"=w21)
    s1 = T1[] []  # shift register
    s2 = T1[] []  # shift register
    s3 = T1[] []  # shift register
    for (N = w21) {
      w22 = each element of w6
      Array To Cluster[NumberOfClusterElements=7](array=w22) -> (cluster=w23)
      Property Node(instance in=w23) -> ("Element 4"=w24)
      case (w24) {
        frame "False", Default {
          w25 = s1
          w26 = s2
          w27 = s3
        }
        frame "Free" {
          Insert Into Array(inArray=s1, new=w23) -> w25
          w26 = s2
          w27 = s3
        }
        frame "Busy" {
          Insert Into Array(inArray=s3, new=w23) -> w27
          w25 = s1
          w26 = s2
        }
        frame "Away" {
          Insert Into Array(inArray=s2, new=w23) -> w26
          w25 = s1
          w27 = s3
        }
      }
      next s1 = w25
      next s2 = w26
      next s3 = w27
    }
    call "createBasicTag.gvi"(configuration=w2, error in=w7) -> (tags=w28, error out=w29)
    call "writeBasicTag.gvi"(tags in=w28, Array=w5, error in=w29) -> (tags out=w30, errror out=w31)
    call "Close Tag (Multiple).gvi"(tags=w30, error in=w31) -> (error out=w32)
    sequence {
      frame 0 {
        call "sendState.gvi"(loop count=w15, Start No.=w14, All Talks=w12, StateColor="Resources/redCircle.png", State Array=s3, error in=w32, configuration=w2) -> (errror out=w33)
      }
    }
    sequence {
      frame 0 {
        call "sendState.gvi"(loop count=w13, Start No.=w16, All Talks=w12, StateColor="Resources/yellowCircle.png", State Array=s2, error in=w32, configuration=w2) -> (errror out=w34)
      }
    }
    sequence {
      frame 0 {
        call "sendState.gvi"(loop count=w14, Start No.=0, All Talks=w12, StateColor="Resources/greenCircle.png", State Array=s1, error in=w32, configuration=w2) -> (errror out=w35)
      }
    }
    Merge Errors(w35, w33, w34) -> (error out=w36)
    s4 = w36  # shift register
    for (N = w18) (iteration -> i1) {
      Subtract(x=8, y=i1) -> w37
      Number To Decimal String(number=w37) -> (decimal integer string=w38)
      Concatenate Strings("SystemLink.Dashboard.Card.Visible.Card", w38) -> w39
      call "Open Tag.gvi"(path=w39, data type="Boolean", error in=s4, configuration=w2) -> (tag=w40, error out=w41)
      call "Write Tag (Boolean).gvi"(tag in=w40, value=FALSE, error in=w41) -> (tag out=w42, error out=w43)
      call "Close Tag (Single).gvi"(tag=w42, error in=w43) -> (error out=w44)
      next s4 = w44
    }
    stop if $stop
  }
  call "Close Configuration.gvi"(configuration=w2, error in=s4) -> (error out=w45)
  $"error out" <- w45
  while (iteration -> i2) (after w1) {
    Wait(time to wait=1000)
    $"loop iteration_2" <- i2
    stop if $stop
  }
